# Grasshopper definition testing_workbench.ghx (Grasshopper 1.0.7)
# plug-ins: jSwan, brain_ghplugin

panel = Panel("""{
    "model": "text-davinci-003",
    "prompt": "Tell me a fairy tale",
    "max_tokens": 256,
    "temperature": 0
}""")
openai_api_key = CSharpScript()  # -> out, key
# ---------- openai_api_key: C# ----------
    key = Environment.GetEnvironmentVariable("OPENAI_API_KEY");
# ---------- end openai_api_key ----------
panel_2 = Panel("https://api.openai.com/v1/completions")
concat = Concatenate(FragmentA="Bearer ", FragmentB=openai_api_key.key)
http_post = HTTPPostRequestComponent(
    Send=Toggle(False),
    Url=panel_2,
    Body=panel,
    ContentType="application/json",
    Authorization=concat,
    Timeout=Slider(5000, range=0..10000))
post_async = HTTPPostRequestComponentAsync(Send=Toggle(False), Url=panel_2, Body=panel, ContentType="application/json", Authorization=concat, Timeout=10000)
dejson = DeserializeJson(JSON=http_post, OutputsLocked=False)  # -> Id, Object, Created, Model, Choices, Usage
dejson_2 = DeserializeJson(JSON=post_async, OutputsLocked=False)  # -> Id, Object, Created, Model, Choices, Usage
dejson_3 = DeserializeJson(JSON=dejson.Choices, OutputsLocked=False)  # -> Text, Index, Logprobs, Finish_reason
dejson_4 = DeserializeJson(JSON=dejson_2.Choices, OutputsLocked=False)  # -> Text, Index, Logprobs, Finish_reason
panel_3 = Panel(dejson_3.Text)
panel_4 = Panel(dejson_4.Text)
